# Grasshopper definition hulltesting_script.gh (Grasshopper 1.0.7)
# plug-ins: DigitalCircularityToolkit

brep = Brep(<brep referenced from the Rhino model>)
mesh = Mesh(<mesh referenced from the Rhino model>)
crv = Curve(<curve referenced from the Rhino model>)
obj = Object(Geometry=brep, NumSamples=50, PCAOverride=Vector(0, 0, 0))
objinfo = ObjectInformation(Object=obj)  # -> Centroid, PCA1, PCA2, PCA3, Length, Width, Height, BoundingBox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
pl = ConstructPlane(Origin=objinfo.Centroid, XAxis=objinfo.PCA1, YAxis=objinfo.PCA2)
hull2d = MakeHull2d(Points=objinfo.SampledPoints, Plane=pl)
