# Grasshopper definition objects_script.gh (Grasshopper 1.0.7)
# plug-ins: DigitalCircularityToolkit, Human

Y = UnitY(Factor=Slider(500, range=500..3000))
mesh = Mesh(<mesh referenced from the Rhino model>)
brep = Brep(<brep referenced from the Rhino model>)
popgeo = PopulateGeometry(Geometry=brep, Count=Slider(100, range=100..500), Seed=1)
pt = Point(popgeo)
move = Move(Geometry=pt, Motion=Y)  # -> Geometry, Transform
pointcloud = ToPointCloud(Points=move.Geometry)
crv = Curve(<curve referenced from the Rhino model>)
planeobj = PlanarObject(Geometry=crv, NumSamples=50, Quantity=1, LengthBuffer=1, WidthBuffer=1, Thickness=-1, PCAOverride=Vector(0, 0, 0))  # -> Object, EffectivePlane
objinfo = ObjectInformation(Object=planeobj.Object)  # -> Centroid, PCA1, PCA2, PCA3, Length, Width, Height, BoundingBox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
geo = Geometry(objinfo.AlignedGeometry)
box = Box(objinfo.BoundingBox)
multiplication = Multiplication(A=objinfo.Length, B=Slider(0.6, range=0..1))
swatch = ColourSwatch(SwatchColor=RGBA(187, 255, 105, 137))
line = LineSDL(Start=objinfo.Centroid, Direction=objinfo.PCA1, Length=multiplication)
line_2 = LineSDL(Start=objinfo.Centroid, Direction=objinfo.PCA2, Length=multiplication)
line_3 = LineSDL(Start=objinfo.Centroid, Direction=objinfo.PCA3, Length=multiplication)
preview = CustomPreview(Geometry=geo, Material=swatch)
preview_2 = CustomPreview(Material=swatch)
number_slider = Slider(4, range=1..4)
previewlw = CustomPreviewLineweights(Geometry=line, Shader=ColourSwatch(SwatchColor=RGB(250, 0, 0)), Thickness=number_slider, Absolute=False)
previewlw_2 = CustomPreviewLineweights(Geometry=line_2, Shader=ColourSwatch(SwatchColor=RGB(0, 54, 250)), Thickness=number_slider, Absolute=False)
previewlw_3 = CustomPreviewLineweights(Geometry=line_3, Shader=ColourSwatch(SwatchColor=RGB(0, 250, 21)), Thickness=number_slider, Absolute=False)
