# Grasshopper definition radialsig_script.gh (Grasshopper 1.0.7)
# plug-ins: DigitalCircularityToolkit

crv = Curve([<curve referenced from the Rhino model> x9])
brep = Brep([<brep referenced from the Rhino model> x102])
crv_2 = Curve([<curve referenced from the Rhino model> x13])
brep_2 = Brep([<brep referenced from the Rhino model> x55])
number_slider = Slider(42, range=2..100)
obj = Object(Geometry=crv_2, NumSamples=50)
obj_2 = Object(Geometry=crv, NumSamples=50)
radial2d = RadialSig2D(DesignObject=obj_2, NumSamples=number_slider)
radial2d_2 = RadialSig2D(DesignObject=obj, NumSamples=number_slider)
objprops = ObjectProperties(Object=obj)  # -> Centroid, PCA1, PCA2, PCA3, Length, Width, Height, BoundingBox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
objprops_2 = ObjectProperties(Object=obj_2)  # -> Centroid, PCA1, PCA2, PCA3, Length, Width, Height, BoundingBox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
abs = Absolute(Value=radial2d)
abs_2 = Absolute(Value=radial2d_2)
graph = QuickGraph(abs_2, SortOrder=0)
graph_2 = QuickGraph(abs, SortOrder=0)
dmeuclidean = EuclideanDistance(Demand=abs, Supply=abs_2, Power=1)
hungarian = Hungarian(DistanceMatrix=dmeuclidean)  # -> Assignment, Cost
item = ListItem(List=obj, Index=hungarian.Assignment, Wrap=True)
matchlines = MatchLines(DemandPoints=objprops_2.Centroid, SupplyPoints=objprops.Centroid, AssignmentIndices=hungarian.Assignment)
alignobj = AlignToObject(SourceObject=item, TargetObject=obj_2)  # -> Object, Geometry, Transform
